# Dynamo graph stuff.dyn (Dynamo 2.19.3.6394)
# packages: spring nodes 210.1.1

file_path = Filename(".\stuff_3d_points_with_zones.csv")
read_data = Python(IN[0]=file_path)  # CPython3
# ---------- read_data.python (49 lines) ----------
# Import required libraries
import sys
import clr
clr.AddReference('ProtoGeometry')
from Autodesk.DesignScript.Geometry import *

# Add pandas to the Python path (adjust this path for your environment)
sys.path.append(r'D:\Anaconda\envs\Dynamo3912\Lib\site-packages')
import pandas as pd

# ===============================
# 1. Read CSV
# ===============================
csv_path = IN[0]  # CSV file path input from Dynamo
df = pd.read_csv(csv_path)

# ===============================
# 2. Group data by instance_id
# ===============================
grouped_data = df.groupby('instance_id')[['x', 'y', 'z', 'category_name', 'zone']]

# Convert each group to a list
grouped_lists = [group.values.tolist() for name, group in grouped_data]

# ===============================
# 3. Generate point sets
# ===============================
point_sets = []
for group in grouped_lists:
    # Multiply by 1000 to convert meters to millimeters (Revit units)
    points = [Point.ByCoordinates(row[0]*1000, row[1]*1000, row[2]*1000) for row in group]
    point_sets.append(points)

# ===============================
# 4. Extract metadata
# ===============================
# Category type (from the first row of each group)
Type = [group[0][3] for group in grouped_lists]

# Instance IDs
InstanceID = list(grouped_data.groups.keys())

# Zone (from the first row of each group)
Zone = [group[0][4] for group in grouped_lists]

# ===============================
# 5. Output
# ===============================
OUT = point_sets, Type, InstanceID, Zone
# ----------------------------------------
tunnel_surface = Python()  # CPython3; unwired: IN[0]
# ---------- tunnel_surface.python (46 lines) ----------
import clr
clr.AddReference('ProtoGeometry')
from Autodesk.DesignScript.Geometry import *
import math

# --------------------------
# 1. Parameters (in mm)
# --------------------------
r = 5050       # Tunnel inner radius
s = 18660      # Arc length along the tunnel cross-section
L = 20000      # Tunnel length along Y-axis

# --------------------------
# 2. Calculate the central angle (radians)
# --------------------------
theta = s / r  # theta = s / r

# --------------------------
# 3. Define key points of the arc
# --------------------------
# Left endpoint (origin)
start_pt = Point.ByCoordinates(0, 0, 0)

# Right endpoint
end_pt = Point.ByCoordinates(2 * r * math.sin(theta / 2), 0, 0)

# Top midpoint of the arc
top_pt = Point.ByCoordinates(
    r * math.sin(theta / 2), 0, r * (1 - math.cos(theta / 2))
)

# --------------------------
# 4. Create the arc
# --------------------------
arc = Arc.ByThreePoints(start_pt, top_pt, end_pt)

# --------------------------
# 5. Extrude the arc along the tunnel length (Y-axis)
# --------------------------
dirY = Vector.ByCoordinates(0, 1, 0)
tunnel_surface = arc.Extrude(dirY, L)

# --------------------------
# 6. Output
# --------------------------
OUT = tunnel_surface
# ----------------------------------------
damage_solid_generation = Python(IN[0]=read_data, IN[1]=tunnel_surface)  # CPython3
# ---------- damage_solid_generation.python (112 lines) ----------
# -*- coding: utf-8 -*-
import sys
import clr
clr.AddReference('ProtoGeometry')
from Autodesk.DesignScript.Geometry import *

def generate_surface(points, direction_flag, tunnel_surface, offset_distance=10000, thickness=-200, center_x=4850):
    """
    Generate a single defect solid.

    Args:
        points (list): List of Autodesk.DesignScript.Geometry.Point objects (3D).
        direction_flag (str): 'c' (top), 'l' (left), or 'r' (right).
        tunnel_surface (Surface): The inner surface of the tunnel.
        offset_distance (float): Offset distance for constructing penetrating planes.
        thickness (float): Final thickness for solid extrusion (mm).
        center_x (float): X-coordinate of the tunnel center for left/right surfaces.

    Returns:
        Solid: The generated defect solid. Returns None if creation fails.
    """
    intersection_curves = []
    
    n = len(points)
    if n < 2:
        return None
    
    # Construct a rectangular plane for each pair of points based on the direction
    for i in range(n):
        p_i = points[i]
        p_next = points[(i + 1) % n]
        
        # Top 'c': perpendicular to XY plane
        if direction_flag == 'c':
            a = Point.ByCoordinates(p_i.X, p_i.Y, 0)
            b = Point.ByCoordinates(p_next.X, p_next.Y, 0)
            c = Point.ByCoordinates(p_next.X, p_next.Y, offset_distance)
            d = Point.ByCoordinates(p_i.X, p_i.Y, offset_distance)
        
        # Left 'l': perpendicular to YZ plane, extend in -X direction
        elif direction_flag == 'l':
            a = Point.ByCoordinates(center_x, p_i.Y, p_i.Z)
            b = Point.ByCoordinates(center_x, p_next.Y, p_next.Z)
            c = Point.ByCoordinates(center_x - offset_distance, p_next.Y, p_next.Z)
            d = Point.ByCoordinates(center_x - offset_distance, p_i.Y, p_i.Z)
        
        # Right 'r': perpendicular to YZ plane, extend in +X direction
        elif direction_flag == 'r':
            a = Point.ByCoordinates(center_x, p_i.Y, p_i.Z)
            b = Point.ByCoordinates(center_x, p_next.Y, p_next.Z)
            c = Point.ByCoordinates(center_x + offset_distance, p_next.Y, p_next.Z)
            d = Point.ByCoordinates(center_x + offset_distance, p_i.Y, p_i.Z)
            
        else:
            return None
        
        rect_surface = None
        
        # Create a rectangular surface from four corner points
        rect = Rectangle.ByCornerPoints([a, b, c, d])
        rect_surface = Surface.ByPatch(rect)
        
        # Compute the intersection with the tunnel inner surface
        inter = rect_surface.Intersect(tunnel_surface)
        if inter and len(inter) > 0:
            for item in inter:
                if item is not None:
                    intersection_curves.append(item)

    # Join all intersection curves and create a surface
    poly = PolyCurve.ByJoinedCurves(intersection_curves)
    patch = Surface.ByPatch(poly)
    
    # Thicken the surface to create a solid
    thickened = Surface.Thicken(patch, thickness)
    
    return thickened

# -----------------------------
# Main program
# -----------------------------
# Input ports:
# IN[0][0]: points_sets (nested list of points)
# IN[0][3]: side_tags (direction flags corresponding to each point set: 'c'/'l'/'r')
# IN[1]: tunnel_surface (tunnel inner surface)

points_sets = IN[0][0]
side_tags = IN[0][3]
tunnel_surface = IN[1]

# Parameters
OFFSET = 10000
THICKNESS = -200
CENTER_X = 4850

surface_defects_elements = []

for pts, flag in zip(points_sets, side_tags):
    # Skip invalid input
    if pts is None or len(pts) < 2:
        surface_defects_elements.append(None)
        continue
    
    # Generate the defect solid and handle exceptions
    try:
        solid = generate_surface(pts, flag, tunnel_surface, offset_distance=OFFSET, thickness=THICKNESS, center_x=CENTER_X)
        surface_defects_elements.append(solid)
    except:
        surface_defects_elements.append(None)

# Output: list of generated defect solids
OUT = surface_defects_elements
# ----------------------------------------
file_path_2 = Filename(".\Metric Generic Model.rft")
risk_value = CodeBlock(Type=read_data, InstanceID=read_data) { Type[1]; InstanceID[2]; }
familyname_generation = Python(IN[0]=risk_value.out1, IN[1]=risk_value.out0)  # CPython3
# ---------- familyname_generation.python (24 lines) ----------
# Load necessary libraries
import sys
import clr
clr.AddReference('ProtoGeometry')
from Autodesk.DesignScript.Geometry import *

# Inputs (from Dynamo IN nodes)
instance_ids = IN[0]      # list of instance IDs
category_names = IN[1]    # list of category names

# Check that both lists are the same length
if len(instance_ids) != len(category_names):
    raise Exception("The lengths of instance_ids and category_names do not match.")

# Generate familyName list
family_names = []

for cat, id in zip(category_names, instance_ids):
    # Concatenate category name + "_" + instance ID
    name = "{}_{}".format(cat, id)
    family_names.append(name)

# Output to Dynamo
OUT = family_names
# ----------------------------------------
categories = Categories("OST_MEPAncillaryFraming")
ꟿ_familyinstance_bygeometry = Custom[ꟿ FamilyInstance.ByGeometry](geometry=damage_solid_generation, familyTemplatePath=file_path_2, familyName=familyname_generation, category=categories)  # package spring nodes; You must provide a valid family template path that will be used for all input geometry objects. The project units(and not the templates) will be used to determine the size of the output geometry. The provided category will be used only if the family template supports it. If not, the default template category will be used instead. Likewise, the family material(provided as a string) will be set only if a material with that name exists in the template. If not, the default material will be used instead ("By Category"). For void cuts, the material settings will be ignored. The Subcategory name is an optional input. If you'd like to skip assigning a Subcategory to any new instance, simply use null. The node expects a unique family name for each geometry object. The rest of the input lists will be processed as if the node lacing is set to longest.
code_block = CodeBlock { "StuffType"; }
setParameterByName = Element.SetParameterByName(element=ꟿ_familyinstance_bygeometry.instance, parameterName=code_block, value=risk_value.out0)
