# Dynamo graph things.dyn (Dynamo 2.19.3.6394)
# packages: spring nodes 210.1.1

file_path = Filename(".\3d_point_info_with_zones.csv")
read_data = Python(IN[0]=file_path)  # CPython3
# ---------- read_data.python (64 lines) ----------
# Import required modules
import sys
import clr
clr.AddReference('ProtoGeometry')
from Autodesk.DesignScript.Geometry import *

# (Adjust this path to your environment)
sys.path.append(r'D:\Anaconda\envs\Dynamo3912\Lib\site-packages')

import pandas as pd

# -------------------------------
# 1. Load CSV data
# -------------------------------
data = pd.read_csv(IN[0])
df = pd.DataFrame(data)

# -------------------------------
# 2. Group by 'instance_id'
# -------------------------------
# Select relevant columns for processing
grouped_data = df.groupby('instance_id')[['x', 'y', 'z', 'category_name', 'risk', 'area_m2', 'zone']]

# Convert each group to a list
grouped_lists = [group.values.tolist() for name, group in grouped_data]

# -------------------------------
# 3. Generate point sets for Dynamo
# -------------------------------
point_sets = []
for group in grouped_lists:
    # Multiply coordinates by 1000 to convert meters to millimeters (Dynamo units)
    points = [Point.ByCoordinates(row[0]*1000, row[1]*1000, row[2]*1000) for row in group]
    point_sets.append(points)

# -------------------------------
# 4. Extract additional properties
# -------------------------------
# Category / Type of defect
Type = [group[0][3] for group in grouped_lists]

# Risk level
Risk = [group[0][4] for group in grouped_lists]

# Area of the defect
Area = [group[0][5] for group in grouped_lists]

# Instance ID
InstanceID = list(grouped_data.groups.keys())

# Zone ('c' = center, 'l' = left, 'r' = right)
Zone = [group[0][6] for group in grouped_lists]

# -------------------------------
# 5. Output
# -------------------------------
# Outputs a tuple of lists:
# point_sets: 3D point sets for each instance
# Type: category name for each instance
# Risk: risk level for each instance
# Area: area of each instance
# InstanceID: unique IDs
# Zone: zone of each instance
OUT = point_sets, Type, Risk, Area, InstanceID, Zone
# ----------------------------------------
tunnel_surface = Python()  # CPython3; unwired: IN[0]
# ---------- tunnel_surface.python (44 lines) ----------
import clr
clr.AddReference('ProtoGeometry')
from Autodesk.DesignScript.Geometry import *
import math

# --------------------------
# Parameters
# --------------------------
r = 5050          # Inner radius (mm)
s = 18660         # Arc length (mm)
L = 20000         # Tunnel length (mm)

# --------------------------
# Calculate central angle of the arc
# --------------------------
theta = s / r  # radians

# --------------------------
# Define key points for the tunnel cross-section
# --------------------------
# Left end as origin
start_pt = Point.ByCoordinates(0, 0, 0)

# Right end (on same horizontal plane)
end_pt = Point.ByCoordinates(2 * r * math.sin(theta / 2), 0, 0)

# Top midpoint of the arc
top_pt = Point.ByCoordinates(
    r * math.sin(theta / 2), 0, r * (1 - math.cos(theta / 2))
)

# --------------------------
# Create the arc for the tunnel cross-section
# --------------------------
arc = Arc.ByThreePoints(start_pt, top_pt, end_pt)

# --------------------------
# Extrude the arc along Y-axis to create tunnel surface
# --------------------------
dirY = Vector.ByCoordinates(0, 1, 0)
tunnel_surface = arc.Extrude(dirY, L)

# Output: the 3D tunnel surface
OUT = tunnel_surface
# ----------------------------------------
damage_solid_generation = Python(IN[0]=read_data, IN[1]=tunnel_surface)  # CPython3
# ---------- damage_solid_generation.python (107 lines) ----------
# -*- coding: utf-8 -*-
import sys
import clr
clr.AddReference('ProtoGeometry')
from Autodesk.DesignScript.Geometry import *

def generate_surface(points, direction_flag, tunnel_surface, offset_distance=10000, thickness=200, center_x=4850):
    """
    Generate a single defect solid along the tunnel surface.
    
    Args:
        points (list): List of Autodesk.DesignScript.Geometry.Point (3D) representing defect boundary.
        direction_flag (str): 'c' (top), 'l' (left), or 'r' (right).
        tunnel_surface (Surface): Inner surface of the tunnel.
        offset_distance (float): Distance to construct the cutting surface.
        thickness (float): Thickness of the final solid (mm).
        center_x (float): X-coordinate of tunnel center for side projections.
        
    Returns:
        Solid: Generated solid defect. Returns None if failed.
    """
    intersection_curves = []
    
    n = len(points)
    if n < 2:
        return None
    
    # Construct a rectangle for each consecutive pair of points
    for i in range(n):
        p_i = points[i]
        p_next = points[(i + 1) % n]
        
        # Top defect 'c': vertical in XY plane
        if direction_flag == 'c':
            a = Point.ByCoordinates(p_i.X, p_i.Y, 0)
            b = Point.ByCoordinates(p_next.X, p_next.Y, 0)
            c = Point.ByCoordinates(p_next.X, p_next.Y, offset_distance)
            d = Point.ByCoordinates(p_i.X, p_i.Y, offset_distance)
        
        # Left defect 'l': vertical in YZ plane, extending -X
        elif direction_flag == 'l':
            a = Point.ByCoordinates(center_x, p_i.Y, p_i.Z)
            b = Point.ByCoordinates(center_x, p_next.Y, p_next.Z)
            c = Point.ByCoordinates(center_x - offset_distance, p_next.Y, p_next.Z)
            d = Point.ByCoordinates(center_x - offset_distance, p_i.Y, p_i.Z)
        
        # Right defect 'r': vertical in YZ plane, extending +X
        elif direction_flag == 'r':
            a = Point.ByCoordinates(center_x, p_i.Y, p_i.Z)
            b = Point.ByCoordinates(center_x, p_next.Y, p_next.Z)
            c = Point.ByCoordinates(center_x + offset_distance, p_next.Y, p_next.Z)
            d = Point.ByCoordinates(center_x + offset_distance, p_i.Y, p_i.Z)
        else:
            return None
        
        # Create rectangle surface
        rect = Rectangle.ByCornerPoints([a, b, c, d])
        rect_surface = Surface.ByPatch(rect)
        
        # Intersect with tunnel surface
        inter = rect_surface.Intersect(tunnel_surface)
        if inter and len(inter) > 0:
            for item in inter:
                if item is not None:
                    intersection_curves.append(item)

    # Join curves and thicken
    poly = PolyCurve.ByJoinedCurves(intersection_curves)
    patch = Surface.ByPatch(poly)
    thickened = Surface.Thicken(patch, thickness)
    
    return thickened

# -----------------------------
# Main Program
# -----------------------------
# Input ports:
# IN[0][0]: points_sets (nested list of points)
# IN[0][5]: side_tags (direction flags corresponding to points: 'c'/'l'/'r')
# IN[1]:    tunnel_surface (inner tunnel surface)

points_sets = IN[0][0]
side_tags = IN[0][5]
tunnel_surface = IN[1]

# Parameters
OFFSET = 10000
THICKNESS = 100
CENTER_X = 4850

surface_defects_elements = []

for pts, flag in zip(points_sets, side_tags):
    # Validate input
    if pts is None or len(pts) < 2:
        surface_defects_elements.append(None)
        continue
    
    # Generate solid and handle exceptions
    try:
        solid = generate_surface(pts, flag, tunnel_surface, offset_distance=OFFSET, thickness=THICKNESS, center_x=CENTER_X)
        surface_defects_elements.append(solid)
    except:
        surface_defects_elements.append(None)

# Output: list of defect solids
OUT = surface_defects_elements
# ----------------------------------------
file_path_2 = Filename(".\Metric Generic Model.rft")
risk_value = CodeBlock(Type=read_data, Risk=read_data, Area=read_data, InstanceID=read_data) { Type[1]; Risk[2]; Area[3]; InstanceID[4]; }
familyname_generation = Python(IN[0]=risk_value.out3, IN[1]=risk_value.out0)  # CPython3
# ---------- familyname_generation.python (24 lines) ----------
# Load the Python Standard and DesignScript Libraries
import sys
import clr
clr.AddReference('ProtoGeometry')
from Autodesk.DesignScript.Geometry import *

# The inputs to this node are stored as a list in the IN variables.
# Inputs
instance_ids = IN[0]          # list of instance IDs
category_names = IN[1]        # list of category names

# Check that the lengths match
if len(instance_ids) != len(category_names):
    raise Exception("The lengths of instance_ids and category_names do not match")

# Generate a list of family names
family_names = []

for cat, id in zip(category_names, instance_ids):
    name = "{}_{}".format(cat, id)  # Concatenate category + "_" + instance_id
    family_names.append(name)

# Output
OUT = family_names
# ----------------------------------------
categories = Categories("OST_GenericModel")
ꟿ_familyinstance_bygeometry = Custom[ꟿ FamilyInstance.ByGeometry](geometry=damage_solid_generation, familyTemplatePath=file_path_2, familyName=familyname_generation, category=categories)  # package spring nodes; You must provide a valid family template path that will be used for all input geometry objects. The project units(and not the templates) will be used to determine the size of the output geometry. The provided category will be used only if the family template supports it. If not, the default template category will be used instead. Likewise, the family material(provided as a string) will be set only if a material with that name exists in the template. If not, the default material will be used instead ("By Category"). For void cuts, the material settings will be ignored. The Subcategory name is an optional input. If you'd like to skip assigning a Subcategory to any new instance, simply use null. The node expects a unique family name for each geometry object. The rest of the input lists will be processed as if the node lacing is set to longest.
code_block = CodeBlock { "DamageType"; }
setParameterByName = Element.SetParameterByName(element=ꟿ_familyinstance_bygeometry.instance, parameterName=code_block, value=risk_value.out0)
code_block_2 = CodeBlock { "InstanceID"; }
setParameterByName_2 = Element.SetParameterByName(element=setParameterByName, parameterName=code_block_2, value=risk_value.out3)
code_block_3 = CodeBlock { "RiskLevel"; }
setParameterByName_3 = Element.SetParameterByName(element=setParameterByName_2, parameterName=code_block_3, value=risk_value.out1)
code_block_4 = CodeBlock { "DamageArea(m2)"; }
setParameterByName_4 = Element.SetParameterByName(element=setParameterByName_3, parameterName=code_block_4, value=risk_value.out2)
string = StringInput("RiskLevel")
getParameterValueByName = Element.GetParameterValueByName(element=setParameterByName_4, parameterName=string)
code_block_5 = CodeBlock { 0; 1; }
remapRange = Math.RemapRange(numbers=getParameterValueByName, newMin=code_block_5.out0, newMax=code_block_5.out1)
color_range = ColorRange(value=remapRange)  # unwired: colors, indices
overrideColorInView = Element.OverrideColorInView(element=setParameterByName_4, color=color_range)
